# Grasshopper definition Drop the curtains.gh (Grasshopper 1.0.7)
# plug-ins: ShapeDiverForGrasshopper

sddp = ShapeDiverDocumentPayload({AbsoluteTolerance=0, AngleTolerance=0, DistanceDisplayPrecision=0, GltfVersion="Gltf2", GrasshopperVersion="1.0.0007", InputGroups="{}", OutputGroups="{}", RelativeTolerance=0, RhinoVersion="7.36.23346.16351", UnitSystem=0, VersionCreated="1.16.0.0", VersionSaved="1.16.0.0"})
H = GetNumber(Slider(4.98, range=1..20), AtLeast=1, AtMost=1, Maximum=1.797693135e+308, Minimum=-1.797693135e+308, TreeAccess=False)
W = GetNumber(Slider(9.71, range=1..20), AtLeast=1, AtMost=1, Maximum=1.797693135e+308, Minimum=-1.797693135e+308, TreeAccess=False)
number_slider = Slider(15, range=0..100)
number_slider_2 = Slider(21, range=0..100)
multiplication = Multiplication(A=H, B=1.1)
multiplication_2 = Multiplication(A=W, B=1.1)
rectangle = Rectangle(Plane=PlaneXY(0, 0, 0), XSize=multiplication_2, YSize=multiplication, Radius=0)  # -> Rectangle, Length
offset_curve = OffsetCurve(Curve=rectangle.Rectangle, Distance=Slider(0.25, range=0..1), Corners=1)
boundary_surfaces = BoundarySurfaces(Edges=flatten([offset_curve, rectangle.Rectangle]))
unit_z = UnitZ(Factor=multiplication)
unit_z_2 = UnitZ(Factor=[multiplication, Slider(-0.25, range=-0.25..1)])
extrude = Extrude(Base=boundary_surfaces, Direction=unit_z)
move = Move(Geometry=offset_curve, Motion=unit_z_2)  # -> Geometry, Transform
horizontal_panel_number = ValueList({"One": 1, "Two": 2, "Three": 3, "Four": 4, "Five": 5, "six": 6}, selected="Five")
number_slider_3 = Slider(5, range=1..5)
boundary_surfaces_2 = BoundarySurfaces(Edges=move.Geometry)
vertical_panel_number = ValueList({"One": 1, "Two": 2, "Three": 3, "Four": 4}, selected="Four")
unit_z_3 = UnitZ(Factor=Slider(0.25, range=0..1))
horizontal_panel_number_2 = GetInteger(Slider(4, range=1..20), AtLeast=1, AtMost=1, Maximum=2147483647, Minimum=-2147483648, TreeAccess=False)
extrude_2 = Extrude(Base=boundary_surfaces_2, Direction=unit_z_3)
vertical_panels_number = GetInteger(Slider(5, range=1..20), AtLeast=1, AtMost=1, Maximum=2147483647, Minimum=-2147483648, TreeAccess=False)
addition = Addition(A=W, B=0.05)
unit_y = UnitY(Factor=Slider(0.032, range=0..0.1))
dimensions = Dimensions()  # -> UDimension, VDimension
area = Area()  # -> Area, Centroid
concatenate = Concatenate(Fragment_A=dimensions.UDimension, A=" X ", Fragment_B=dimensions.VDimension)
number_of_openings = GetInteger(Slider(5, range=0..100), AtLeast=1, AtMost=1, Maximum=2147483647, Minimum=-2147483648, TreeAccess=False)
series = Series(Start=0, Step=1, Count=number_of_openings)
slabs = Data(extrude_2)
number_slider_4 = Slider(360, range=300..360)
mesh = Mesh(slabs)
unit_x = UnitX(Factor=1)
deconstruct_mesh = DeconstructMesh(Mesh=mesh)  # -> Vertices, Faces, Colours, Normals
negative = Negative(Value=Slider(46, range=0..60))
colour = GetString(ColourSwatch(SwatchColor=RGBA(39, 158, 217, 137)), AtLeast=1, AtMost=1, TreeAccess=False)
construct_mesh = ConstructMesh(Vertices=deconstruct_mesh.Vertices, Faces=deconstruct_mesh.Faces, Colours=ColourSwatch(SwatchColor=RGB(0, 0, 0)))
context_bake = ContextBake(Geometry=construct_mesh)

xz_plane = XZPlane(Origin=Point(0, 0, 0))
rectangle_2 = Rectangle(Plane=xz_plane, XSize=W, YSize=H, Radius=0)  # -> Rectangle, Length
horizontal_frame = HorizontalFrame(Curve=reparameterize(offset_curve), Parameter=Slider(0.02, range=0..1))
negative_2 = Negative(Value=Slider(0.26, range=0..1))
orient = Orient(Geometry=rectangle_2.Rectangle, Source=offset_curve, Target=horizontal_frame)  # -> Geometry, Transform
explode = Explode(Curve=orient.Geometry, Recursive=True)  # -> Segments, Vertices
unit_y_2 = UnitY(Factor=negative_2)
extrude_3 = Extrude(Base=orient.Geometry, Direction=unit_y_2)
list_item = ListItem(List=explode.Segments, Index=0, Wrap=True)  # -> Item, Item1
cap_holes_ex = CapHolesEx(Brep=extrude_3)  # -> Brep, Caps, Solid
curve = Curve([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])
curve_2 = Curve([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])
length = Length(Curve=list_item.Item)
length_2 = Length(Curve=list_item.Item1)
rotate_axis = RotateAxis(Geometry=curve_2, Angle=1.570796327, Axis=Line((0.025, 0, 0), (0.025, -0.16, 0)))  # -> Geometry, Transform
unit_z_4 = UnitZ(Factor=length_2)
unit_y_3 = UnitY(Factor=Slider(-0.12, range=-0.12..1))
negative_3 = Negative(Value=addition)
boundary_surfaces_3 = BoundarySurfaces(Edges=orient.Geometry)
unit_x_2 = UnitX(Factor=negative_3)
move_2 = Move(Geometry=boundary_surfaces_3, Motion=unit_y_3)  # -> Geometry, Transform
negative_4 = Negative(Value=Slider(0.03, range=0..1))
unit_y_4 = UnitY(Factor=negative_4)

length_3 = Length(Curve=list_item.Item)
trim_solid = TrimSolid(Shape=extrude, Cutters=cap_holes_ex.Brep)
division = Division(A=length_3, B=horizontal_panel_number_2)

wind_pressure_kg_sqm = Slider(69, range=50..90)
multiplication_3 = Multiplication(A=Slider(4.5, range=1..15), B=100)
multiplication_4 = Multiplication(A=division, B=100)
expression = Expression(Q=wind_pressure_kg_sqm, H=multiplication_3, i=multiplication_4, Expression="(((Q/10000)*i)*H^4)/(700000*H*(1/300))")
multiplication_5 = Multiplication(A="0.013", B=expression)
panel = Panel(multiplication_5)
concatenate_2 = Concatenate(Fragment_A="profile inertia (cm4) needed", Fragment_B="=", A=panel)
panel_2 = Panel(concatenate_2)

length_4 = Length(Curve=list_item.Item1)
custom_preview = CustomPreview(Geometry=[trim_solid, extrude_2], Material=ColourSwatch(SwatchColor=RGB(166, 166, 166)))
divide_distance = DivideDistance(Curve=list_item.Item, Distance=division)  # -> Points, Tangents, Parameters
division_2 = Division(A=length_4, B=vertical_panels_number)
divide_length = DivideLength(Curve=list_item.Item1, Length=division_2)  # -> Points, Tangents, Parameters
walls = Data(trim_solid)
mesh_2 = Mesh(walls)
deconstruct_mesh_2 = DeconstructMesh(Mesh=mesh_2)  # -> Vertices, Faces, Colours, Normals
construct_mesh_2 = ConstructMesh(
    Vertices=deconstruct_mesh_2.Vertices,
    Faces=deconstruct_mesh_2.Faces,
    Colours=ColourSwatch(SwatchColor=RGB(122, 122, 122)))
context_bake_2 = ContextBake(Geometry=construct_mesh_2)

orient_2 = Orient(Geometry=graft(curve), Source=PlaneXY(0, 0, 0), Target=divide_distance.Points)  # -> flatten(Geometry), Transform
boundary_surfaces_4 = BoundarySurfaces(Edges=orient_2.Geometry)
orient_3 = Orient(Geometry=graft(rotate_axis.Geometry), Source=PlaneXY(0, 0, 0), Target=divide_length.Points)  # -> Geometry, Transform
extrude_4 = Extrude(Base=boundary_surfaces_4, Direction=unit_z_4)
boundary_surfaces_5 = BoundarySurfaces(Edges=flatten(orient_3.Geometry))
extrude_5 = Extrude(Base=boundary_surfaces_5, Direction=unit_x_2)
bounding_box = BoundingBox(Content=[extrude_5, extrude_4], Plane=PlaneXY(0, 0, 0), UnionBox=False)  # -> Box, Box_2
solid_union = SolidUnion(Breps=flatten(bounding_box.Box))
brep_brep = BrepBrep(BrepA=flatten(solid_union), BrepB=move_2.Geometry)  # -> Curves, Points
custom_preview_2 = CustomPreview(Geometry=[extrude_5, extrude_4], Material=ColourSwatch(SwatchColor=RGB(54, 54, 54)))
offset_curve_2 = OffsetCurve(Curve=brep_brep.Curves, Distance=Slider(0.016, range=0..0.1), Corners=1)
boundary_surfaces_6 = BoundarySurfaces(Edges=flatten(offset_curve_2))
move_3 = Move(Geometry=boundary_surfaces_6, Motion=unit_y_4)  # -> Geometry, Transform

list_length = ListLength(List=extrude_5)
list_length_2 = ListLength(List=extrude_4)
list_length_3 = ListLength()
list_length_4 = ListLength()
multiplication_6 = Multiplication(A=list_length_2, B=length_2)
multiplication_7 = Multiplication(A=list_length, B=length)
multiplication_8 = Multiplication(A=list_length_4)
multiplication_9 = Multiplication(A=list_length_3)
addition_2 = Addition(A=multiplication_6, B=multiplication_7, C=multiplication_8, D=multiplication_9)
concatenate_3 = Concatenate(FragmentA=addition_2, FragmentB="  M/L")
dowsil_895_structural_glazing_sealant = Panel(concatenate_3)

addition_3 = Addition(A=multiplication_6, B=multiplication_8)
addition_4 = Addition(A=multiplication_7, B=multiplication_9)
division_3 = Division(A=addition_3, B=6.5)
division_4 = Division(A=addition_4, B=6.5)
round = Round(Number=division_3)  # -> Nearest, Floor, Ceiling
round_2 = Round(Number=division_4)  # -> Nearest, Floor, Ceiling
concatenate_4 = Concatenate(Fragment_A="6.00 m Bars = ", Fragment_B=round.Nearest, A=" Bars")
concatenate_5 = Concatenate(Fragment_A="6.00 m Bars = ", Fragment_B=round_2.Nearest, A=" Bars")
bars_for_mullions = Panel(concatenate_4)
bars_for_transoms = Panel(concatenate_5)

curve_3 = Curve(boundary_surfaces_6)
dimensions_2 = Dimensions(Surface=boundary_surfaces_6)  # -> UDimension, VDimension
area_2 = Area(Geometry=boundary_surfaces_6)  # -> Area, Centroid
explode_2 = Explode(Curve=curve_3, Recursive=True)  # -> Segments, Vertices
context_print = ContextPrint(SilliconStructureFilling=dowsil_895_structural_glazing_sealant)
extrude_6 = Extrude(Base=move_3.Geometry, Direction=unit_y)

custom_preview_3 = CustomPreview(Geometry=extrude_6, Material=ColourSwatch(SwatchColor=RGBA(54, 192, 227, 68)))

concatenate_6 = Concatenate(Fragment_A=dimensions_2.UDimension, A=" X ", Fragment_B=dimensions_2.VDimension)
mass_addition = MassAddition(Input=[area_2.Area, area.Area])  # -> Result, PartialResults
deconstruct_vector = DeconstructVector(Vector=explode_2.Segments)  # -> XComponent, YComponent, ZComponent
cap_holes = CapHoles(Brep=extrude_6)
polygon_center = PolygonCenter(Polyline=boundary_surfaces_6)  # -> CenterV, CenterE, CenterA
entwine = Entwine(Branch00=concatenate_6, Branch01=concatenate, FlattenInputs=True)  # -> flatten(Result)
cull_pattern = CullPattern(List=explode_2.Segments, CullPattern=deconstruct_vector.ZComponent)
context_print_2 = ContextPrint(TransomProfileBars=bars_for_transoms)
context_print_3 = ContextPrint(MullionProfileBars=bars_for_mullions)
list_item_2 = ListItem(List=flatten(cull_pattern), Index=0, Wrap=True)
length_5 = Length(Curve=list_item_2)
list_length_5 = ListLength(List=entwine)
glass_panels = Data(flatten(cap_holes))
mullions_g = Data(flatten(extrude_4))
transoms = Data(flatten(extrude_5))
division_5 = Division(A=length_5, B=2)
cull_index = CullIndex(List=cap_holes, Indices=series, Wrap=True)
list_item_3 = ListItem(List=cap_holes, Index=series, Wrap=True)
unit_z_5 = UnitZ(Factor=division_5)
list_item_4 = ListItem(List=polygon_center.CenterV, Index=series, Wrap=True)
area_3 = Data(mass_addition.Result)
concatenate_7 = Concatenate(FragmentA="Area = ", FragmentB=area_3)
mesh_3 = Mesh(cull_index)
move_4 = Move(Geometry=list_item_4, Motion=unit_z_5)  # -> Geometry, Transform
deconstruct_mesh_3 = DeconstructMesh(Mesh=mesh_3)  # -> Vertices, Faces, Colours, Normals
panel_3 = Panel(concatenate_7)
panel_4 = Panel(list_length_5)
line_sdl = LineSDL(Start=move_4.Geometry, Direction=unit_x, Length=1)
rotate_axis_2 = RotateAxis(Geometry=list_item_3, Angle=degrees(negative), Axis=line_sdl)  # -> Geometry, Transform
construct_mesh_3 = ConstructMesh(Vertices=deconstruct_mesh_3.Vertices, Faces=deconstruct_mesh_3.Faces, Colours=colour)
context_print_4 = ContextPrint(NumberOfPanels=panel_4)
context_print_5 = ContextPrint(AreaOfGlassPanels=panel_3)
mesh_4 = Mesh(rotate_axis_2.Geometry)
deconstruct_mesh_4 = DeconstructMesh(Mesh=mesh_4)  # -> Vertices, Faces, Colours, Normals
context_bake_3 = ContextBake(GlazingPanels=construct_mesh_3)
context_bake_4 = ContextBake(Geometry=transoms)
context_bake_5 = ContextBake(Geometry=mullions_g)
construct_mesh_4 = ConstructMesh(Vertices=deconstruct_mesh_4.Vertices, Faces=deconstruct_mesh_4.Faces, Colours=colour)
context_bake_6 = ContextBake(OpeningPanels=construct_mesh_4)
