# Grasshopper definition S-AlyMahmoud-CurtainsDrop.gh (Grasshopper 1.0.7)

number_slider = Slider(3.56, range=1..20)
number_slider_2 = Slider(3.75, range=1..20)
geometry = Geometry(<brep referenced from the Rhino model>)
geometry_2 = Geometry([<brep referenced from the Rhino model> x2])
brep_brep = BrepBrep(BrepA=geometry_2, BrepB=geometry)  # -> Curves, Points
round = Round(Number=number_slider)  # -> Nearest, Floor, Ceiling
number_slider_3 = Slider(1, range=0..10)
width = GetNumber(number_slider, AtLeast=1, AtMost=1, Maximum=1.797693135e+308, Minimum=-1.797693135e+308, TreeAccess=False)
height = GetNumber(number_slider_2, AtLeast=1, AtMost=1, Maximum=1.797693135e+308, Minimum=-1.797693135e+308, TreeAccess=False)
xz_plane = XZPlane(Origin=Point(0, 0, 0))
multiplication = Multiplication(A=number_slider, B=1.005)
negative = Negative(Value=multiplication)
rectangle = Rectangle(Plane=xz_plane, XSize=width, YSize=height, Radius=0)  # -> Rectangle, Length
negative_2 = Negative(Value=number_slider_3)
construct_domain = ConstructDomain(DomainStart=multiplication, DomainEnd=negative)
unit_y = UnitY(Factor=[number_slider_3, negative_2])
multiplication_2 = Multiplication(A=number_slider_2, B=1.2)
explode = Explode(Curve=rectangle.Rectangle, Recursive=True)  # -> Segments, Vertices
extrude = Extrude(Base=rectangle.Rectangle, Direction=unit_y)
cap_holes = CapHoles(Brep=extrude)
multiplication_3 = Multiplication(A=number_slider_2, B=1.2)
list_item = ListItem(List=explode.Segments, Index=0, Wrap=True)  # -> Item1, Item, Item1_2, Item2
curve = Curve(list_item.Item)
curve_2 = Curve(list_item.Item1_2)
unit_z = UnitZ(Factor=multiplication_3)
curve_middle = CurveMiddle(Curve=curve)
point = Point(curve_middle)
rectangle_2 = Rectangle(Plane=point, XSize=construct_domain, YSize=multiplication_2, Radius=0)  # -> Rectangle, Length
offset_curve_loose = OffsetCurveLoose(Curve=rectangle_2.Rectangle, Distance=Slider(0.25, range=0..1))

deconstruct_vector = DeconstructVector(Vector=explode.Segments)  # -> XComponent, YComponent, ZComponent
cull_pattern = CullPattern(List=explode.Segments, CullPattern=deconstruct_vector.ZComponent)
horizontal_panels_number = GetInteger(Slider(4, range=1..20), AtLeast=1, AtMost=1, Maximum=2147483647, Minimum=-2147483648, TreeAccess=False)
length = Length(Curve=curve)
cull_pattern_2 = CullPattern(List=explode.Segments, CullPattern=deconstruct_vector.XComponent)
list_item_2 = ListItem(List=cull_pattern, Index=0, Wrap=True)  # -> Item, Item1
vertical_panels_number = GetInteger(Slider(4, range=1..20), AtLeast=1, AtMost=1, Maximum=2147483647, Minimum=-2147483648, TreeAccess=False)
length_2 = Length(Curve=curve_2)
division = Division(A=length, B=horizontal_panels_number)
list_item_3 = ListItem(List=cull_pattern_2, Index=0, Wrap=True)  # -> Item, Item1
flip_curve = FlipCurve(Curve=list_item_2.Item)  # -> Curve, Flag
division_2 = Division(A=length_2, B=vertical_panels_number)
flip_curve_2 = FlipCurve(Curve=list_item_3.Item, Guide=list_item_3.Item1)  # -> Curve, Flag
length_3 = Length(Curve=flip_curve_2.Curve)
divide_length = DivideLength(Curve=flip_curve_2.Curve, Length=division)  # -> Points, Tangents, Parameters
divide_length_2 = DivideLength(Curve=list_item_3.Item1, Length=division)  # -> Points, Tangents, Parameters
divide_length_3 = DivideLength(Curve=list_item_2.Item1, Length=division_2)  # -> Points, Tangents, Parameters
divide_length_4 = DivideLength(Curve=flip_curve.Curve, Length=division_2)  # -> Points, Tangents, Parameters
line = Line(StartPoint=divide_length.Points, EndPoint=divide_length_2.Points)
line_2 = Line(StartPoint=divide_length_4.Points, EndPoint=divide_length_3.Points)

boundary_surfaces = BoundarySurfaces(Edges=[rectangle_2.Rectangle, offset_curve_loose])
boundary_surfaces_2 = BoundarySurfaces(Edges=offset_curve_loose)
extrude_2 = Extrude(Base=boundary_surfaces, Direction=unit_z)
move = Move(Geometry=boundary_surfaces_2, Motion=unit_z)  # -> Geometry, Transform
unit_z_2 = UnitZ(Factor=Slider(0.2, range=0..1))
trim_solid = TrimSolid(Shape=extrude_2, Cutters=cap_holes)
extrude_3 = Extrude(Base=move.Geometry, Direction=unit_z_2)
geometry_3 = Geometry(flatten([trim_solid, extrude_3]))
end_points = EndPoints(Curve=list_item_2.Item)  # -> Start, End
end_points_2 = EndPoints(Curve=list_item_2.Item1)  # -> Start, End
context_bake = ContextBake(Geometry=geometry_3)
line_3 = Line(StartPoint=[end_points.Start, end_points_2.Start], EndPoint=[end_points_2.End, end_points.End])
line_4 = Line(StartPoint=[end_points.Start, end_points_2.Start], EndPoint=[end_points_2.End, end_points.End])
length_4 = Length(Curve=list_item.Item1_2)
length_5 = Length(Curve=list_item.Item)
vector_2pt = Vector2Pt(PointA=divide_length_4.Points, PointB=divide_length_3.Points, Unitize=False)  # -> Vector, Length

curve_3 = Curve(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)
rotate_axis = RotateAxis(Geometry=curve_3, Angle=1.570796327, Axis=Line((0.025, 0, 0), (0.025, -0.16, 0)))  # -> Geometry, Transform
orient = Orient(Geometry=rotate_axis.Geometry, Source=PlaneXY(0, 0, 0), Target=divide_length_4.Points)  # -> Geometry, Transform

curve_4 = Curve(line)

curve_5 = Curve(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)
orient_2 = Orient(Geometry=graft(curve_5), Source=PlaneXY(0, 0, 0), Target=divide_length.Points)  # -> flatten(Geometry), Transform

addition = Addition(A=vector_2pt.Length, B=0.05)
curve_6 = Curve([line_3, line_4, line_2])

addition_2 = Addition(A=length_5, B=0.05)
negative_3 = Negative(Value=addition_2)
boundary_surfaces_3 = BoundarySurfaces(Edges=flatten(orient.Geometry))
unit_x = UnitX(Factor=negative_3)

fixing_height = GetNumber(Slider(2, range=2..15), AtLeast=1, AtMost=1, Maximum=1.797693135e+308, Minimum=-1.797693135e+308, TreeAccess=False)

unit_z_3 = UnitZ(Factor=length_4)
boundary_surfaces_4 = BoundarySurfaces(Edges=orient_2.Geometry)

line_sdl = LineSDL(Start=divide_length_4.Points, Direction=vector_2pt.Vector, Length=addition)
boundary_surfaces_5 = BoundarySurfaces(Edges=rectangle.Rectangle)
extrude_along = ExtrudeAlong(Base=boundary_surfaces_4, Curve=curve_4)
polygon_center = PolygonCenter(Polyline=boundary_surfaces_5)  # -> CenterV, CenterE, CenterA
unit_y_2 = UnitY(Factor=Slider(-0.12, range=-0.12..1))
extrude_along_2 = ExtrudeAlong(Base=boundary_surfaces_3, Curve=line_sdl)
scale = Scale(Geometry=boundary_surfaces_5, Center=polygon_center.CenterV, Factor="1.002")  # -> Geometry, Transform
move_2 = Move(Geometry=scale.Geometry, Motion=unit_y_2)  # -> Geometry, Transform
bounding_box = BoundingBox(Content=[extrude_along, extrude_along_2], Plane=PlaneXY(0, 0, 0), UnionBox=False)  # -> Box, Box_2
solid_union = SolidUnion(Breps=flatten(bounding_box.Box))

custom_preview = CustomPreview(Geometry=[extrude_along_2, extrude_along], Material=ColourSwatch(SwatchColor=RGB(54, 54, 54)))

brep_brep_2 = BrepBrep(BrepA=flatten(solid_union), BrepB=move_2.Geometry)  # -> Curves, Points
offset_curve = OffsetCurve(Curve=brep_brep_2.Curves, Distance=Slider(0.016, range=0..0.1), Corners=1)
negative_4 = Negative(Value=Slider(0.06, range=0..1))
boundary_surfaces_6 = BoundarySurfaces(Edges=flatten(offset_curve))
list_item_4 = ListItem(List=boundary_surfaces_6, Index=0, Wrap=True)
unit_y_3 = UnitY(Factor=negative_4)
list_length = ListLength(List=boundary_surfaces_6)
area = Area(Geometry=list_item_4)  # -> Area, Centroid
multiplication_4 = Multiplication(A=Slider(2.25, range=0..10), B=Slider(3.2, range=0..10))
dimensions = Dimensions(Surface=list_item_4)  # -> UDimension, VDimension
move_3 = Move(Geometry=boundary_surfaces_6, Motion=unit_y_3)  # -> Geometry, Transform
larger_than = LargerThan(FirstNumber=area.Area, SecondNumber=multiplication_4)  # -> LargerThan, OrEqualTo
unit_y_4 = UnitY(Factor=Slider(0.02, range=0..0.1))

list_length_2 = ListLength(List=extrude_along_2)
list_length_3 = ListLength(List=extrude_along)
multiplication_5 = Multiplication(A=list_length_3, B=length_4)
multiplication_6 = Multiplication(A=list_length_2, B=length_5)
addition_3 = Addition(A=multiplication_5, B=multiplication_6)
concatenate = Concatenate(FragmentA=addition_3, FragmentB="  M/L")
addition_4 = Addition(A=multiplication_5)
addition_5 = Addition(A=multiplication_6)
division_3 = Division(A=addition_5, B=6)
division_4 = Division(A=addition_4, B=6)
dowsil_895_structural_glazing_sealant = Panel(concatenate)
round_2 = Round(Number=division_4)  # -> Nearest, Floor, Ceiling
round_3 = Round(Number=division_3)  # -> Nearest, Floor, Ceiling
area_2 = Area(Geometry=boundary_surfaces_6)  # -> Area, Centroid
context_print = ContextPrint(SilliconStructureFilling=dowsil_895_structural_glazing_sealant)
concatenate_2 = Concatenate(Fragment_A="6.00 m Bars = ", Fragment_B=round_2.Nearest, A=" Bars")
concatenate_3 = Concatenate(Fragment_A="6.00 m Bars = ", Fragment_B=round_3.Nearest, A=" Bars")
bars_for_mullions = Panel(concatenate_2)
bars_for_transoms = Panel(concatenate_3)
mass_addition = MassAddition(Input=area_2.Area)  # -> Result, PartialResults
area_3 = Data(mass_addition.Result)
concatenate_4 = Concatenate(FragmentA="Area = ", FragmentB=area_3)
panel = Panel(concatenate_4)
context_print_2 = ContextPrint(MullionProfileBarsToPurchase=bars_for_mullions)
context_print_3 = ContextPrint(TransomProfileBarsToPurchase=bars_for_transoms)
context_print_4 = ContextPrint(GlazingArea=panel)

extrude_4 = Extrude(Base=move_3.Geometry, Direction=unit_y_4)
concatenate_5 = Concatenate(C=list_length, Fragment_A="  panels with size = ", B=dimensions.UDimension, Fragment_B="X", A=dimensions.VDimension)
concatenate_6 = Concatenate(
    C=list_length,
    Fragment_A="  panels with size = ",
    B=dimensions.UDimension,
    Fragment_B="X",
    A=dimensions.VDimension,
    D="   warning panel size larger than standard")
custom_preview_2 = CustomPreview(Geometry=extrude_4, Material=ColourSwatch(SwatchColor=RGBA(54, 192, 227, 68)))
cap_holes_2 = CapHoles(Brep=extrude_4)
glass_panels = Data(flatten(cap_holes_2))
mullions_g = Data(flatten(extrude_along))
transoms = Data(flatten(extrude_along_2))
stream_filter = StreamFilter(Gate=larger_than.LargerThan, Stream0=concatenate_5, Stream1=concatenate_6)

walls = Data()
slabs = Data()
mesh = Mesh(slabs)
mesh_2 = Mesh(walls)
mesh_3 = Mesh()
mesh_4 = Mesh(glass_panels)
deconstruct_mesh = DeconstructMesh(Mesh=mesh)  # -> Vertices, Faces, Colours, Normals
deconstruct_mesh_2 = DeconstructMesh(Mesh=mesh_2)  # -> Vertices, Faces, Colours, Normals
deconstruct_mesh_3 = DeconstructMesh(Mesh=mesh_3)  # -> Vertices, Faces, Colours, Normals
deconstruct_mesh_4 = DeconstructMesh(Mesh=mesh_4)  # -> Vertices, Faces, Colours, Normals
colour = GetString(ColourSwatch(SwatchColor=RGBA(39, 158, 217, 137)), AtLeast=1, AtMost=1, TreeAccess=False)
construct_mesh = ConstructMesh(Vertices=deconstruct_mesh.Vertices, Faces=deconstruct_mesh.Faces, Colours=ColourSwatch(SwatchColor=RGB(0, 0, 0)))
construct_mesh_2 = ConstructMesh(
    Vertices=deconstruct_mesh_2.Vertices,
    Faces=deconstruct_mesh_2.Faces,
    Colours=ColourSwatch(SwatchColor=RGB(122, 122, 122)))
construct_mesh_3 = ConstructMesh(Vertices=deconstruct_mesh_3.Vertices, Faces=deconstruct_mesh_3.Faces)
construct_mesh_4 = ConstructMesh(Vertices=deconstruct_mesh_4.Vertices, Faces=deconstruct_mesh_4.Faces, Colours=colour)

panel_2 = Panel(stream_filter)
context_print_5 = ContextPrint(PanelsNumberAndSize=stream_filter)

context_bake_2 = ContextBake(GlazingPanels=construct_mesh_4)
context_bake_3 = ContextBake(Geometry=transoms)
context_bake_4 = ContextBake(Geometry=mullions_g)

# ----
# Warning profile with long depth and high inertia needed ( not recommended)
wind_pressure_kg_sqm = Slider(69, range=50..90)
multiplication_7 = Multiplication(A=division, B=100)
multiplication_8 = Multiplication(A=fixing_height, B=100)
expression = Expression(Q=wind_pressure_kg_sqm, H=multiplication_8, i=multiplication_7, Expression="(((Q/10000)*i)*H^4)/(700000*H*(1/300))")
multiplication_9 = Multiplication(A="0.013", B=expression)
panel_4 = Panel(multiplication_9)
larger_than_2 = LargerThan(FirstNumber=multiplication_9, SecondNumber=Slider(600, range=0..1000))  # -> LargerThan, OrEqualTo
concatenate_7 = Concatenate(Fragment_A="profile with inertia", Fragment_B="=", A=panel_4, B=" cm4 needed")

concatenate_8 = Concatenate(
    Fragment_A="profile with inertia",
    Fragment_B="=",
    A=panel_4,
    B=" cm4 needed",
    C="   Warning fixing height is too large not recommended")

stream_filter_2 = StreamFilter(Gate=larger_than_2.LargerThan, Stream0=concatenate_7, Stream1=concatenate_8)
panel_5 = Panel(concatenate_8)
panel_6 = Panel(stream_filter_2)

context_print_6 = ContextPrint(RecommendedProfileInertia=stream_filter_2)
