# Grasshopper definition S-AlyMahmoud-Hops.gh (Grasshopper 1.0.7)
# plug-ins: Hops

panel = Panel("https://github.com/iaac-macad/CurtainsDrop/raw/main/S-AlyMahmoud-CurtainsDrop.gh")
value_list = ValueList({"One": 1, "Two": 2, "Three": 3, "Four": 4}, selected="Four")
value_list_2 = ValueList({"One": 1, "Two": 2, "Three": 3, "Four": 4, "Five": 5, "six": 6}, selected="Four")
hops = Hops(
    _Path=panel,
    FixingHeight=Slider(5, range=0..10),
    Colour=ColourSwatch(SwatchColor=RGBA(90, 184, 191, 128)),
    HorizontalPanelsNumber=value_list,
    Width=Slider(4.64, range=0..10),
    Height=Slider(6, range=0..10),
    VerticalPanelsNumber=value_list_2,
    CacheResultsInMemory=True,
    CacheSolveResults=True,
    RemoteDefinitionLocation="https://github.com/iaac-macad/CurtainsDrop/raw/main/S-AlyMahmoud-CurtainsDrop.gh",
    RemoteSolveVersion=(0, 1, 0),
    ShowInput_Enabled=False,
    ShowInput_Path=True,
    SynchronousSolve=True)  # -> RecommendedProfileInertia, Mullions, Transoms, GlazingPanels, PanelsNumberAndSize, Block, SilliconStructureFilling, MullionProfileBarsToPurchase, TransomProfileBarsToPurchase, GlazingArea
complex = Complex()
geometry = Geometry(hops.Mullions)
panel_2 = Panel(hops.PanelsNumberAndSize)
panel_3 = Panel(hops.TransomProfileBarsToPurchase)
panel_4 = Panel(hops.SilliconStructureFilling)
panel_5 = Panel(hops.MullionProfileBarsToPurchase)
panel_6 = Panel(hops.GlazingArea)
panel_7 = Panel(hops.RecommendedProfileInertia)
geometry_2 = Geometry(hops.Transoms)
geometry_3 = Geometry(hops.GlazingPanels)
